# Dynamo graph ES Floor_Sheet1_script.dyn (Dynamo 2.6.2.15705)
# packages: spring nodes 204.1.0, Genius Loci 2022.4.19, RIE 2020.8.11, Clockwork for Dynamo 2.x 2.3.0, archi-lab.net 2021.25.2721, DynaMEP 2.0.1, Rhythm 2023.1.1, Data-Shapes 2022.2.98

file_path = Filename("G:\Shared drives\PYREVIT_ES\PYREVIT_ES\livio.jpeg")
categories = Categories("OST_Sheets")
all_elements_of_category = ElementsOfCategory(Category=categories)
code_block = CodeBlock(e=all_elements_of_category) { e.Name; }
code_block_2 = CodeBlock { "FP"; }
contains = String.Contains(str=code_block, searchFor=code_block_2)
filterByBoolMask = List.FilterByBoolMask(list=all_elements_of_category, mask=contains)
code_block_3 = CodeBlock(e=filterByBoolMask.in) { e.Name; }

# group: UI Cartooon Manage
code_block_4 = CodeBlock { "Create New Managed Floor Sheet"; }
code_block_5 = CodeBlock { true; 700; "Cancel"; "Ok"; }
code_block_6 = CodeBlock()
# ---------- code_block_6.designscript (2 lines) ----------
"Instruction";
"1. Select the sheet to create manged sheets \n2. Make sure that a base view is created for each floor for key plan\n3. Copy the name of base view and paste in the text box below and run the script";
# ----------------------------------------
textnote_data = Custom[TextNote Data](Title=code_block_6.out0, TextNote=code_block_6.out1)  # package Data-Shapes; Create Data for TextNote input in UI.MultipleInputForm ++ . Check out www.data-shapes.net for more informations
code_block_7 = CodeBlock { "Select Sheet"; }
dropdown_data = Custom[DropDown Data](InputName=code_block_7, Keys=code_block_3, Values=filterByBoolMask.in)  # package Data-Shapes; Create data for DropDown input in UI.MultiInputForm ++ . Check out www.data-shapes.net for more infos.
code_block_8 = CodeBlock { "Sample Floor Plan"; "FFFL_ES"; }
textbox_data = Custom[TextBox Data](InputName=code_block_8.out0, DefaultText=code_block_8.out1)  # package Data-Shapes; Create Data for TextBox input in UI.MultipleInputForm ++ . Check out www.data-shapes.net for more informations
code_block_9 = CodeBlock { "Select ViewPort Type"; }
get_all_viewport_types = Custom[Get All Viewport Types]()  # package archi-lab.net; This node will retrieve all Viewport Types currently in the model.
name = Element.Name(element=get_all_viewport_types)
dropdown_data_2 = Custom[DropDown Data](InputName=code_block_9, Keys=name, Values=get_all_viewport_types)
list_create = List.Create(item0=textnote_data, item1=dropdown_data, item2=textbox_data, item3=dropdown_data_2)
multipleinputform = Custom[MultipleInputForm ++](Description_optional=code_block_4, Logo_optional=file_path, ButtonText_optional=code_block_5.out3, Inputs=list_create, Toggle=code_block_5.out0, CancelButtonText_optional=code_block_5.out2, MaxHeight_optional=code_block_5.out1, Width_optional=code_block_5.out1)  # package Data-Shapes; Create a form with multiple inputs. see www.data-shapes.net for tutorials and infos!
code_block_10 = CodeBlock(x=multipleinputform.User_Inputs) { Selected_Sheet = x[0]; Floor_Plan = x[1]; ViewportType = x[2]; }

titleblock_types = TitleblockTypes("ES TITLEBLOCK Arch D:ARCH D")

# group: Create Sheets
code_block_11 = CodeBlock(e=code_block_10.Selected_Sheet) { e.Name; }
code_block_12 = CodeBlock { "_ES"; }
add = code_block_11 + code_block_12
create_sheet = Custom[Create Sheet](sheetName=add, sheetNumber=add, titleBlock=titleblock_types)  # package Genius Loci; Creates new sheets.
code_block_13 = CodeBlock { "AREA"; "ES"; }
setParameterByName = Element.SetParameterByName(element=create_sheet.Sheets, parameterName=code_block_13.out0, value=code_block_13.out1)

RIE_WaitFor = Custom[RIE_WaitFor](Passthrough=code_block_10.Selected_Sheet, WaitFor=setParameterByName)  # package RIE
ꟿ_sheet_views = Custom[ꟿ Sheet.Views+](sheet=RIE_WaitFor)  # package spring nodes; Extracts all views and schedules (minus the revision schedule) placed on the input sheet (or sheets). Will be depreciated once the bult in node works with all plan types.
code_block_14 = CodeBlock(e=ꟿ_sheet_views.view_s) { e.Name; }
sheets = Sheets()  # nothing selected; frozen
viewports = archilab.Revit.Views.Sheets.Viewports(sheet=sheets)
views = Views()  # nothing selected
view_byname = Custom[View ByName](ViewName=code_block_10.Floor_Plan)  # package Genius Loci; Collect views by given name in the active or given document. Based on a Christian Gartland's script.
code_block_15 = CodeBlock(e=code_block_10.Selected_Sheet) { e.Name; }
code_block_16 = CodeBlock(e=view_byname, sheetName=code_block_15) { e.Name + sheetName; }
color_palette = ColorPalette({R: 255, G: 0, B: 0, A: 255})
code_block_17 = CodeBlock { ["Structural Framing", "Structural Columns"]; }
byName = Category.ByName(name=code_block_17)
all_elements_of_category_2 = ElementsOfCategory(Category=byName)
code_block_18 = CodeBlock { "BIMSF_Container"; "Equals"; }
ʳʰʸᵗʰᵐ_elementfilter = Rhythm.Revit.ElementFilter.ElementFilter.ByParameterStringValue(elements=all_elements_of_category_2, parameterName=code_block_18.out0, value=code_block_15, filterMethod=code_block_18.out1)
name_2 = Element.Name(element=view_byname)
code_block_19 = CodeBlock(X=name_2, Y=code_block_15) { X+Y; }
duplicateWithDetailing = Custom[View.DuplicateWithDetailing](view=view_byname, name=code_block_19)  # package Clockwork for Dynamo 2.x; Duplicates a given view with detailing
overrideColorInView = RevitModel.Element.OverrideColorInView(color=color_palette, element=ʳʰʸᵗʰᵐ_elementfilter, view=duplicateWithDetailing)
code_block_20 = CodeBlock { "Sample 3D View"; "Sample_3D View"; }  # frozen
textbox_data_2 = Custom[TextBox Data](InputName=code_block_20.out0, DefaultText=code_block_20.out1)
RIE_GetAllViewTemplates = Custom[RIE_GetAllViewTemplates]()  # package RIE
get_all_viewport_types_2 = Custom[Get All Viewport Types]()  # frozen
viewport_type = StringInput("Viewport 1")  # graph input
name_3 = Element.Name(element=get_all_viewport_types_2)
eq = viewport_type == name_3
filterByBoolMask_2 = List.FilterByBoolMask(list=get_all_viewport_types_2, mask=eq)
code_block_21 = CodeBlock { 3; 2; }
code_block_22 = CodeBlock(x=code_block_21.out0, y=code_block_21.out1)
# ---------- code_block_22.designscript (5 lines) ----------
Point.ByCoordinates(x*0.55,y*0.7);
Framing_Floor_Plan= Point.ByCoordinates(x*0.32,y*1.0);
Framing_3d = Point.ByCoordinates(x*0.32,y*0.7);
Framing_3d_Duplicate = Point.ByCoordinates(x*0.32,y*0.35);
FFFL_ES =Point.ByCoordinates(2.774,1.25);
# ----------------------------------------
# note: Framing Floor Plan
# note: Panel Layout
ʳʰʸᵗʰᵐ_viewport_create = Rhythm.Revit.Elements.Viewport.Create(sheet=setParameterByName, view=duplicateWithDetailing, location=code_block_22.FFFL_ES)
code_block_23 = CodeBlock { "Title on Sheet"; }
getParameterValueByName = Element.GetParameterValueByName(element=ꟿ_sheet_views.view_s, parameterName=code_block_23)

# group: Floor Plan view from sheet
flatten = List.Flatten(list=ꟿ_sheet_views.view_s)
code_block_24 = CodeBlock { ["Floor Panel Plan View"]; }
RIE_IndexOf = Custom[RIE_IndexOf](list=getParameterValueByName, Item=code_block_24, lacing=Longest)  # package RIE
flatten_2 = List.Flatten(list=RIE_IndexOf)
getItemAtIndex = List.GetItemAtIndex(list=flatten, index=flatten_2)

code_block_25 = CodeBlock(e=getItemAtIndex) { e.Name + "_ES"; }
duplicateWithDetailing_2 = Custom[View.DuplicateWithDetailing](view=getItemAtIndex, name=code_block_25)
code_block_26 = CodeBlock { "ES_Floor_Plan"; }
python_script = Python(IN[0]=code_block_26)
# ---------- python_script.python (39 lines) ----------
#By Kapil palewar
#Get view Template by name 

import clr
clr.AddReference('ProtoGeometry')
from Autodesk.DesignScript.Geometry import *
# Import ToDSType(bool) extension method
clr.AddReference("RevitNodes")
import Revit
clr.ImportExtensions(Revit.Elements)
# Import geometry conversion extension methods
clr.ImportExtensions(Revit.GeometryConversion)
# Import DocumentManager and TransactionManager
clr.AddReference("RevitServices")
import RevitServices
from RevitServices.Persistence import DocumentManager
from RevitServices.Transactions import TransactionManager
from System.Collections.Generic import *
# Import RevitAPI
clr.AddReference("RevitAPI")
import Autodesk
from Autodesk.Revit.DB import *

doc = DocumentManager.Instance.CurrentDBDocument
uiapp = DocumentManager.Instance.CurrentUIApplication
app = uiapp.Application
uidoc=DocumentManager.Instance.CurrentUIApplication.ActiveUIDocument

viewTempName = IN[0]
views = []


collector = FilteredElementCollector(doc).OfClass(View)
for i in collector:
	if i.Name == viewTempName:
		views.append(i)


OUT=views
# ----------------------------------------

# group: Framing_Floor_Plan
setViewTemplate = archilab.Revit.Views.Views.SetViewTemplate(view=duplicateWithDetailing_2, viewTemplate=python_script, lacing=Longest)
# note: Framing 3D
ʳʰʸᵗʰᵐ_viewport_create_2 = Rhythm.Revit.Elements.Viewport.Create(sheet=setParameterByName, view=setViewTemplate, location=code_block_22.Framing_Floor_Plan)

# group: Framing 3d view from sheet
flatten_3 = List.Flatten(list=ꟿ_sheet_views.view_s)
code_block_27 = CodeBlock { ["Floor Panel 3D View"]; }
RIE_IndexOf_2 = Custom[RIE_IndexOf](list=getParameterValueByName, Item=code_block_27, lacing=Longest)
flatten_4 = List.Flatten(list=RIE_IndexOf_2)
getItemAtIndex_2 = List.GetItemAtIndex(list=flatten_3, index=flatten_4)

# group: Framing_3d
flatten_5 = List.Flatten(list=getItemAtIndex_2)
code_block_28 = CodeBlock(e=getItemAtIndex_2) { e.Name; }
code_block_29 = CodeBlock(x=code_block_28) { x+DSCore.List.Flatten(["_ES"]); }
flatten_6 = List.Flatten(list=code_block_29)
duplicate = Custom[View.Duplicate](view=flatten_5, name=flatten_6)  # package Clockwork for Dynamo 2.x; Duplicates a given view

# group: Framing_3d_Duplicate
flatten_7 = List.Flatten(list=getItemAtIndex_2)
code_block_30 = CodeBlock(e=getItemAtIndex_2) { e.Name; }
code_block_31 = CodeBlock(x=code_block_30) { x+DSCore.List.Flatten(["D_ES"]); }
flatten_8 = List.Flatten(list=code_block_31)
duplicate_2 = Custom[View.Duplicate](view=flatten_7, name=flatten_8)

code_block_32 = CodeBlock(x=duplicate, y=duplicate_2) { x[0]; y[0]; }
code_block_33 = CodeBlock { "ES_Floor_3D"; }
python_script_2 = Python(IN[0]=code_block_33)  # same code as python_script

# group: Framing_3d
setViewTemplate_2 = archilab.Revit.Views.Views.SetViewTemplate(view=code_block_32.out0, viewTemplate=python_script_2, lacing=Longest)
ʳʰʸᵗʰᵐ_viewport_create_3 = Rhythm.Revit.Elements.Viewport.Create(sheet=setParameterByName, view=setViewTemplate_2, location=code_block_22.Framing_3d_Duplicate)

# group: Framing_3d_Duplicate
setViewTemplate_3 = archilab.Revit.Views.Views.SetViewTemplate(view=code_block_32.out1, viewTemplate=python_script_2, lacing=Longest)
ʳʰʸᵗʰᵐ_viewport_create_4 = Rhythm.Revit.Elements.Viewport.Create(sheet=setParameterByName, view=setViewTemplate_3, location=code_block_22.Framing_3d)

list_create_2 = List.Create(item0=ʳʰʸᵗʰᵐ_viewport_create, item1=ʳʰʸᵗʰᵐ_viewport_create_2, item2=ʳʰʸᵗʰᵐ_viewport_create_3, item3=ʳʰʸᵗʰᵐ_viewport_create_4)
flatten_9 = List.Flatten(list=list_create_2)
string = StringInput("Type")
setParameterByName_2 = Element.SetParameterByName(element=flatten_9, parameterName=string, value=code_block_10.ViewportType, lacing=Longest)
